% Simulink data dictionary csro_ctrl_data.sldd

f2_sys_config = Simulink.ConfigSet(StartTime="0", StopTime="100", FixedStep="0.1", Solver="FixedStepAuto", ProdHWDeviceType="ARM Compatible->ARM Cortex-M", SystemTargetFile="ert.tlc", TargetLang="C")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

modbus_regs = Simulink.Bus(DataScope="Imported", HeaderFile="mb_config.h")
  discs: uint8[256]
  coils: uint8[256]
  inputs: int16[256]
  holdings: int16[256]

sys_regs = Simulink.Signal(StorageClass="ImportFromFile", HeaderFile="fnd_com.h", DataType="Bus: modbus_regs")